# Grasshopper definition 170721_SphereCollide_01.gh (Grasshopper 0.9.76)

mesh = Mesh([<mesh referenced from the Rhino model> x2])
number_slider = Slider(500000, range=0..1000000)
facen = FaceNormals(Mesh=mesh)  # -> Centers, Normals
pl = PlaneNormal(Origin=facen.Centers, ZAxis=facen.Normals)
vdis = VectorDisplay(Anchor=facen.Centers, Vector=expr("x * 3", facen.Normals))
pt = Point(<point referenced from the Rhino model>)
pt_2 = Point(<point referenced from the Rhino model>)
pln = Plane(flatten(pl))
box = Box2Pt(PointA=pt_2, PointB=pt, Plane=PlaneXY(0, 0, 0))

# ---- group: Particle Count
int = Integer(Slider(30000, range=0..100000))

# ----
box_2 = Box(box)
wires = BrepWireframe(Brep=box_2, Density=-1)
int_2 = Integer(int)
pln_2 = Plane(pln)
int_3 = Integer(int)

# ---- group: SphereCollide
c_script = CSharpScript(
    count=int_2,
    radius=Slider(0.5, range=0..100),
    weight=Slider(1, range=0..100),
    Reference=["C:\USERS\DAVID\APPDATA\ROAMING\GRASSHOPPER\LIBRARIES\SPATIALSLUR\SpatialSlur.dll", "C:\USERS\DAVID\APPDATA\ROAMING\GRASSHOPPER\LIBRARIES\SPATIALSLUR\SlurRhino.dll"])  # -> out, result; inputs count: Int32, radius: Double, weight: Double
# ---------- c_script: C# ----------
    result = new SphereCollide(Enumerable.Range(0, count), radius, weight);
# ---------- end c_script ----------

# ---- group: AbovePlane
c_script_2 = CSharpScript(
    count=int_3,
    plane=pln_2,
    weight=Slider(10, range=0..100),
    Reference=["C:\USERS\DAVID\APPDATA\ROAMING\GRASSHOPPER\LIBRARIES\SPATIALSLUR\SpatialSlur.dll", "C:\USERS\DAVID\APPDATA\ROAMING\GRASSHOPPER\LIBRARIES\SPATIALSLUR\SlurRhino.dll"])  # -> out, result; inputs count: Int32, plane: Plane, weight: Double
# ---------- c_script_2: C# ----------
    var o = plane.Origin.ToVec3d();
    var n = plane.Normal.ToVec3d();
    result = new AbovePlane(Enumerable.Range(0, count), o, n, weight);
# ---------- end c_script_2 ----------

# ----
box_3 = Box(box_2)
int_4 = Integer(int)

# ---- group: Settings
c_script_3 = CSharpScript(
    timeStep=Slider(1, range=0..1),
    damping=Slider(0.9, range=0..1),
    Reference=["C:\USERS\DAVID\APPDATA\ROAMING\GRASSHOPPER\LIBRARIES\SPATIALSLUR\SpatialSlur.dll", "C:\USERS\DAVID\APPDATA\ROAMING\GRASSHOPPER\LIBRARIES\SPATIALSLUR\SlurRhino.dll"])  # -> out, result; inputs timeStep: Double, damping: Double
# ---------- c_script_3: C# ----------
    result = new ConstraintSolverSettings(){TimeStep = timeStep, Damping = damping};
# ---------- end c_script_3 ----------

# ---- group: Particle Positions
c_script_4 = CSharpScript(
    domain=box_3,
    count=int_4,
    seed=Slider(1, range=0..10),
    Reference=["C:\USERS\DAVID\APPDATA\ROAMING\GRASSHOPPER\LIBRARIES\SPATIALSLUR\SpatialSlur.dll", "C:\USERS\DAVID\APPDATA\ROAMING\GRASSHOPPER\LIBRARIES\SPATIALSLUR\SlurRhino.dll"])  # -> out, result; inputs domain: Box, count: Int32, seed: Int32
# ---------- c_script_4: C# ----------
    var points = new Vec3d[count];

    var random = new Random(seed);
    var d = domain.BoundingBox.ToDomain3d();

    for(int i = 0; i < count; i++)
      points[i] = random.NextVec3d(d);

    result = new GH_ObjectWrapper(points);
# ---------- end c_script_4 ----------

# ----
merge = Merge(Data1=c_script_2.result, Data2=c_script.result)
list = ValueList({"Reset": 0, "Play": 1, "Pause": 2}, selected="Pause")
data = Data(c_script_4.result)
data_2 = Data(merge)
data_3 = Data(c_script_3.result)
c_script_5 = CSharpScript(
    positions=data,
    constraints=data_2,
    settings=data_3,
    subSteps=Slider(1, range=0..100),
    simState=list,
    Reference=["C:\Users\David\AppData\Roaming\Grasshopper\Libraries\SpatialSlur\SpatialSlur.dll", "C:\Users\David\AppData\Roaming\Grasshopper\Libraries\SpatialSlur\SlurRhino.dll"])  # -> out, result; inputs constraints: list, subSteps: Int32, simState: Int32
# ---------- c_script_5: C# ----------
    //reset
    if(simState == 0)
    {
      Reset();
      return;
    }

    // setup
    if(_solver == null)
    {
      Init((IEnumerable<Vec3d>) positions);
    }

    // update constraints & settings
    _constraints = constraints.Select(obj => (IConstraint) obj).ToList();
    _solver.Settings = (ConstraintSolverSettings) settings;

    // step solver
    for(int i = 0; i < subSteps; i++)
      _solver.StepParallel(_particles, _constraints);

    // print details
    Print(String.Format("Step {0}", _solver.StepCount));

    // expire solution
    if(simState == 1)
      Component.ExpireSolution(true);

    // update display
    UpdateDisplay();
# ---------- c_script_5: C# additional code ----------
  List<IBody> _particles;
  List<IConstraint> _constraints;
  ConstraintSolver _solver;

  PointCloud _pointCloud;
  BoundingBox _clippingBox;


  /// <summary>
  ///
  /// </summary>
  /// <returns></returns>
  void Reset()
  {
    _solver = null;
    _pointCloud = null;
  }


  /// <summary>
  ///
  /// </summary>
  /// <param name="particlePositions"></param>
  /// <param name="constraints"></param>
  /// <returns></returns>
  void Init(IEnumerable<Vec3d> particlePositions)
  {
    _particles = particlePositions.Select(p => (IBody) new SpatialSlur.SlurDynamics.Particle(p)).ToList();
    _solver = new ConstraintSolver();

    InitDisplay();
  }


  /// <summary>
  ///
  /// </summary>
  /// <returns></returns>
  void InitDisplay()
  {
    _pointCloud = new PointCloud(_particles.Select(p => p.Position.ToPoint3d()));
  }


  /// <summary>
  ///
  /// </summary>
  /// <returns></returns>
  void UpdateDisplay()
  {
    _clippingBox = BoundingBox.Empty;

    for(int i = 0; i < _particles.Count; i++)
    {
      var p = _particles[i].Position.ToPoint3d();
      _pointCloud[i].Location = p;
      _clippingBox.Union(p);
    }
  }


  /// <summary>
  ///
  /// </summary>
  public override BoundingBox ClippingBox
  {
    get {return _clippingBox;}
  }


  /// <summary>
  ///
  /// </summary>
  /// <param name="args"></param>
  /// <returns></returns>
  public override void DrawViewportWires(IGH_PreviewArgs args)
  {
    if(_pointCloud != null)
    {
      args.Display.DrawPointCloud(_pointCloud, 2, Color.Black);
    }
  }
# ---------- end c_script_5 ----------
panel = Panel(c_script_5.out)
